# Grasshopper definition try-tunny.gh (Grasshopper 1.0.7)
# Copyright: AMDlab
# plug-ins: Tunny

genes = GenePool(
    Decimals=0,
    Maximum=10000,
    Minimum=0,
    Value=[274, 821, 4115, 694, 483, 1046, 1742, 4004, 2489, 1190, 3914, 4056, 8052, 3769, 4337, 612, 2397, 3860, 2692, 612, 119, 655, 3688, 1046, 252])

# ----
# Nurbs Surfaceの作成
number_slider = Slider(10000, range=1000..100000)
division = Division(A=number_slider, B="4")
sqgrid = Square(Plane=PlaneXY(0, 0, 0), Size=division, ExtentX="4", ExtentY="4")  # -> Cells, flatten(Points)
addition = Addition(A="4", B="1")
Z = UnitZ(Factor=genes)
move = Move(Geometry=sqgrid.Points, Motion=Z)  # -> Geometry, Transform
srfgrid = SurfaceFromPoints(Points=move.Geometry, UCount=addition, Interpolate=False)

# ----
# ラチスシェルのグリッド
number_slider_2 = Slider(10000, range=1000..100000)
division_2 = Division(A=number_slider_2, B="10")
sqgrid_2 = Square(Plane=PlaneXY(0, 0, 0), Size=division_2, ExtentX="10", ExtentY="10")  # -> Cells, flatten(Points)
Z_2 = UnitZ(Factor="1")
move_2 = Move(Geometry=sqgrid_2.Points, Motion=Z_2)  # -> Geometry, Transform
ln = Line(StartPoint=sqgrid_2.Points, EndPoint=move_2.Geometry)

# ----
# ラチスシェルの点作成
number_slider_3 = Slider(0, range=0..10000)
# ラチスシェルのZ固定
number_slider_4 = Slider(120, range=0..440)
slx = SurfaceLine(Surface=srfgrid, Line=ln, LimitToFirst=False)  # -> Curves, flatten(Points), UVPoints, Normal
merge = Merge(
    Data1=number_slider_3,
    Data2=Slider(0, range=0..10000),
    Data3=Slider(5000, range=0..10000),
    Data4=Slider(0, range=0..10000),
    Data5=Slider(0, range=0..10000))
merge_2 = Merge(
    Data1=Slider(0, range=0..440),
    Data2=Slider(10, range=0..440),
    Data3=Slider(60, range=0..440),
    Data4=Slider(110, range=0..440),
    Data5=number_slider_4)
pdecon = Deconstruct(Point=slx.Points)  # -> XComponent, YComponent, ZComponent
replace = ReplaceItems(List=pdecon.ZComponent, Item=merge, Indices=merge_2, Wrap=False)
pt = ConstructPoint(XCoordinate=pdecon.XComponent, YCoordinate=pdecon.YComponent, ZCoordinate=replace)

# ----
# ラチスシェルの梁作成
panel = Panel("1")
addition_2 = Addition(A="10", B=panel)
partition = PartitionList(List=pt, Size=addition_2)
tstat = TreeStatistics(Tree=partition)  # -> Paths, Length, Count
cull_i = CullIndex(List=partition, Indices="0", Wrap=True)
cull_i_2 = CullIndex(List=partition, Indices="-1", Wrap=True)
cull_i_3 = CullIndex(List=tstat.Paths, Indices="0", Wrap=True)
cull_i_4 = CullIndex(List=tstat.Paths, Indices="-1", Wrap=True)
ln_2 = Line(StartPoint=cull_i, EndPoint=cull_i_2)  # -> flatten(Line)
branch = TreeBranch(Tree=partition, Path=cull_i_3, MaintainPaths=True)
branch_2 = TreeBranch(Tree=partition, Path=cull_i_4, MaintainPaths=True)
ln_3 = Line(StartPoint=branch, EndPoint=branch_2)  # -> flatten(Line)
y方向梁 = Line(ln_2)
x方向梁 = Line(ln_3)
merge_3 = Merge(Data1=y方向梁, Data2=x方向梁)
梁 = Line(merge_3)

# ----
# 部材長一様化
梁_2 = Line(梁)
len = Length(Curve=梁_2)
avr = Average(Input=len)
subtraction = Subtraction(A=len, B=avr)
sqr = Square(Value=subtraction)
ma = MassAddition(Input=sqr)  # -> Result, PartialResults
lng = ListLength(List=len)
division_3 = Division(A=ma.Result, B=lng)
sqrt = SquareRoot(Value=division_3)
標準偏差_長さ = Number(sqrt)

tunny = Tunny(Variables=genes, Objectives=標準偏差_長さ)
